# Grasshopper definition MARTIAN STOCHASTIC AGGREGATION MASTER FILE.gh (Grasshopper 1.0.7)
# plug-ins: Human UI, Bifocals

srf = Surface(<surface referenced from the Rhino model>)
bbox = BoundingBox(Content=srf, Plane=PlaneXY(0, 0, 0))  # -> Box, Box_2
volume = Volume(Geometry=bbox.Box)  # -> Volume, Centroid
scale_nu = ScaleNU(
    Geometry=bbox.Box,
    Plane=volume.Centroid,
    ScaleX=Slider(1.2, range=0..10),
    ScaleY=Slider(1.2, range=0..10),
    ScaleZ=Slider(1.7, range=0..10))  # -> Geometry, Transform
fieldpts = Wasp_FieldPoints(BOU=scale_nu.Geometry, RES=Slider(10, range=0..10))  # -> E_FIELD, PTS; inputs BOU: list of Mesh, PLN: Plane; plug-in component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

# ----
# Field Surface
surface = Surface(<surface referenced from the Rhino model>)
bounding_box = BoundingBox(Content=surface, Plane=PlaneXY(0, 0, 0))  # -> Box, Box_2
volume_2 = Volume(Geometry=bounding_box.Box)  # -> Volume, Centroid
scale_nu_2 = ScaleNU(Geometry=bounding_box.Box, Plane=volume_2.Centroid, ScaleX=1, ScaleY=1, ScaleZ=Slider(2.3, range=0..10))  # -> Geometry, Transform

geo = Geometry(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)
attribute = Wasp_Attribute(ID="Pod", VAL=geo, TR=Toggle(True))  # -> ATTR; inputs VAL: list, TR: Boolean; plug-in component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

geo_2 = Geometry(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)
# 3
attribute_2 = Wasp_Attribute(ID="Food", VAL=geo_2, TR=Toggle(True))  # -> ATTR; inputs VAL: list, TR: Boolean; plug-in component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

geo_3 = Geometry(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)
attribute_3 = Wasp_Attribute(ID="Central", VAL=geo_3, TR=Toggle(True))  # -> ATTR; inputs VAL: list, TR: Boolean; plug-in component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

panel = Panel("""POD_A
POD_A
POD_A""")
geo_4 = Geometry(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)
pt = Point([Point(-4.5, 5.196152423, 3), Point(2.25, 1.299038106, 3), Point(2.25, 9.09326674, 3)])
crv = Curve([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])
conndir = Wasp_ConnectionFromDirection(GEO=geo_4, CEN=pt, UP=crv, T=panel)  # -> CONN, PLN_OUT; inputs CEN: list of Point3d, UP: list of Curve, T: list; plug-in component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
# Center
# Module
# 1
part = Wasp_BasicPart(NAME="POD_MOD", GEO=geo_4, CONN=flatten(conndir.CONN), ATTR=attribute)  # -> PART; inputs GEO: Mesh, CONN: list, ATTR: list; plug-in component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

crv_2 = Curve([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])
panel_2 = Panel("""FOD_A
FOD_B
FOD_A
FOD_B
FOD_A
FOD_B
FOD_SUP""")
geo_5 = Geometry(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)
pt_2 = Point([Point(-51.25, 1.299038106, 3), Point(-37.75, 1.299038106, 3), Point(-31, 12.99038106, 3), Point(-37.75, 24.68172401, 3), Point(-51.25, 24.68172401, 3), Point(-58, 12.99038106, 3), Point(-44.5, 12.99038106, 0)])
conndir_2 = Wasp_ConnectionFromDirection(GEO=geo_5, CEN=pt_2, UP=crv_2, T=panel_2)  # -> CONN, PLN_OUT; inputs CEN: list of Point3d, UP: list of Curve, T: list; plug-in component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
# Pod Res
# Module
# 2
part_2 = Wasp_BasicPart(NAME="FOD_MOD", GEO=geo_5, CONN=flatten(conndir_2.CONN), ATTR=attribute_2)  # -> PART; inputs GEO: Mesh, CONN: list, ATTR: list; plug-in component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

panel_3 = Panel("""CEN_TOP
CEN_TOP
CEN_TOP
CEN_TOP
CEN_TOP
CEN_TOP
CEN_MID
CEN_MID
CEN_MID
CEN_BOT
CEN_BOT
CEN_BOT
CEN_BOT
CEN_BOT
CEN_BOT""")
pt_3 = Point([Point(101, 5.924857353, 22.5), Point(107.75, 2.027743036, 22.5), Point(121.25, 9.82197167, 22.5), Point(121.25, 17.6162003, 22.5), Point(107.75, 25.41042894, 22.5), Point(101, 21.51331462, 22.5), Point(103.25, 2.027743036, 13.5), Point(123.5, 13.71908599, 13.5), Point(103.25, 25.41042894, 13.5), Point(101, 5.924857353, 4.5), Point(107.75, 2.027743036, 4.5), Point(121.25, 9.82197167, 4.5), Point(121.25, 17.6162003, 4.5), Point(107.75, 25.41042894, 4.5), Point(101, 21.51331462, 4.5)])
geo_6 = Geometry(<brep referenced from the Rhino model>)
crv_3 = Curve([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])
conndir_3 = Wasp_ConnectionFromDirection(GEO=geo_6, CEN=pt_3, UP=crv_3, T=panel_3)  # -> CONN, PLN_OUT; inputs CEN: list of Point3d, UP: list of Curve, T: list; plug-in component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
part_3 = Wasp_BasicPart(NAME="CEN_MOD", GEO=geo_6, CONN=flatten(conndir_3.CONN), ATTR=attribute_3)  # -> PART; inputs GEO: Mesh, CONN: list, ATTR: list; plug-in component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

geo_7 = Geometry(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)
attribute_4 = Wasp_Attribute(ID="Factory", VAL=geo_7, TR=Toggle(True))  # -> ATTR; inputs VAL: list, TR: Boolean; plug-in component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

geo_8 = Geometry(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)
attribute_5 = Wasp_Attribute(ID="Life", VAL=geo_8, TR=Toggle(True))  # -> ATTR; inputs VAL: list, TR: Boolean; plug-in component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

# ----
# Food
# Module
toggle = BooleanToggle(True)
geo_9 = Geometry([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])
# 6
attribute_6 = Wasp_Attribute(ID="Docking", VAL=geo_9, TR=toggle)  # -> ATTR; inputs VAL: list, TR: Boolean; plug-in component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

panel_4 = Panel("""FCT_A
FCT_B
FCT_A
FCT_B""")
geo_10 = Geometry(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)
crv_4 = Curve([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])
pt_4 = Point([Point(57.74940316, 1.299382689, 3.00091889), Point(62.25, 1.299038106, 3.01720071), Point(62.25, 24.68172401, 3.01720071), Point(57.74940316, 24.68137942, 3.00091889)])
conndir_4 = Wasp_ConnectionFromDirection(GEO=geo_10, CEN=pt_4, UP=crv_4, T=panel_4)  # -> CONN, PLN_OUT; inputs CEN: list of Point3d, UP: list of Curve, T: list; plug-in component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
part_4 = Wasp_BasicPart(NAME="FCT_MOD", GEO=geo_10, CONN=flatten(conndir_4.CONN), ATTR=attribute_4)  # -> PART; inputs GEO: Mesh, CONN: list, ATTR: list; plug-in component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

crv_5 = Curve([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])
panel_5 = Panel("""LIF_A
LIF_A
LIF_B
LIF_B""")
geo_11 = Geometry(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)
pt_5 = Point([Point(75.5, 5.196152423, 3.01720071), Point(82.25, 1.299038106, 3.01720071), Point(89, 12.99038106, 3.01720071), Point(82.25, 16.88749537, 3.01720071)])
conndir_5 = Wasp_ConnectionFromDirection(GEO=geo_11, CEN=pt_5, UP=crv_5, T=panel_5)  # -> CONN, PLN_OUT; inputs CEN: list of Point3d, UP: list of Curve, T: list; plug-in component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
# Factory
# Module
# 4
part_5 = Wasp_BasicPart(NAME="LIF_MOD", GEO=geo_11, CONN=flatten(conndir_5.CONN), ATTR=attribute_5)  # -> PART; inputs GEO: Mesh, CONN: list, ATTR: list; plug-in component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

crv_6 = Curve(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)
geo_12 = Geometry(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)
pt_6 = Point(Point(-15.5, 5.196152423, 3))
conndir_6 = Wasp_ConnectionFromDirection(GEO=geo_12, CEN=pt_6, UP=crv_6, T="DOC_A")  # -> CONN, PLN_OUT; inputs CEN: list of Point3d, UP: list of Curve, T: list; plug-in component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
# 5
part_6 = Wasp_BasicPart(NAME="DOC_MOD", GEO=geo_12, CONN=flatten(conndir_6.CONN), ATTR=attribute_6)  # -> PART; inputs GEO: Mesh, CONN: list, ATTR: list; plug-in component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

fieldpts_2 = Wasp_FieldPoints(BOU=scale_nu_2.Geometry, RES=Slider(10, range=0..10))  # -> E_FIELD, PTS; inputs BOU: list of Mesh, PLN: Plane; plug-in component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
pull_point = PullPoint(Point=fieldpts_2.PTS, Geometry=surface, ClosestOnly=True)  # -> ClosestPoint, Distance
deconstruct = Deconstruct(Point=fieldpts_2.PTS)  # -> XComponent, YComponent, ZComponent
deconstruct_2 = Deconstruct(Point=pull_point.ClosestPoint)  # -> XComponent, YComponent, ZComponent
smaller_than = SmallerThan(FirstNumber=deconstruct.ZComponent, SecondNumber=deconstruct_2.ZComponent)  # -> SmallerThan, OrEqualTo
dispatch = Dispatch(List=pull_point.Distance, DispatchPattern=smaller_than.SmallerThan)  # -> ListA, ListB
dispatch_2 = Dispatch(List=fieldpts_2.PTS, DispatchPattern=smaller_than.SmallerThan)  # -> ListA, ListB
list_length = ListLength(List=dispatch.ListA)
point = Point(dispatch_2.ListA)
repeat_data = RepeatData(Data=Slider(0, range=0..100), Length=list_length)
remap = Remap(data=dispatch.ListB, min=Slider(1, range=0..1), max=Slider(0, range=0..1))
graph_mapper = GraphMapper(
    remap,
    x0=0,
    x1=1,
    y0=0,
    y1=1,
    container_name="Bezier",
    cpx=[0, 0.8587699533, 0.7750014067, 1],
    cpy=[0, 0, 0.2819010615, 1])
weave = Weave(Pattern=smaller_than.SmallerThan, Stream0=graph_mapper, Stream1=repeat_data, NullGaps=False)
gradient = Gradient(LowerLimit=0, UpperLimit=1, Parameter=weave, stops=[0: RGB(0, 128, 0), 0.5: RGB(255, 255, 0), 1: RGB(255, 0, 0)])
custom_preview = CustomPreview(Geometry=fieldpts_2.PTS, Material=gradient)

number_slider = Slider(0.5, range=0..1)  # disabled
number_slider_2 = Slider(0.9, range=0..1)  # disabled
number_slider_3 = Slider(0.1, range=0..1)  # disabled
number_slider_4 = Slider(1, range=0..1)  # disabled
number_slider_5 = Slider(0.5, range=0..1)  # disabled
construct_domain = ConstructDomain(DomainStart=number_slider_3, DomainEnd=number_slider_2)  # disabled

surface_2 = Surface(<surface referenced from the Rhino model>)  # disabled
dimensions = Dimensions(Surface=surface_2)  # -> UDimension, VDimension; disabled
number_slider_6 = Slider(100, range=20..100)  # disabled
plane_surface = PlaneSurface(Plane=PlaneXY(0, 0, 0), XSize=dimensions.UDimension, YSize=dimensions.VDimension)  # disabled
curve = Curve(plane_surface)  # disabled
populate_geometry = PopulateGeometry(Geometry=plane_surface, Count=number_slider_6, Seed=1)  # disabled
voronoi = Voronoi(Points=populate_geometry, Boundary=curve, BruteForceOverride=False)  # disabled
number_slider_7 = Slider(0.9, range=0..1)  # disabled
area = Area(Geometry=voronoi)  # -> Area, Centroid; disabled
scale = Scale(Geometry=voronoi, Center=area.Centroid, Factor=number_slider_7)  # -> Geometry, Transform; disabled
curve_2 = Curve(flatten([curve, scale.Geometry]))  # disabled
unit_z = UnitZ(Factor=number_slider)  # disabled
boundary_surfaces = BoundarySurfaces(Edges=curve_2)  # disabled
extrude = Extrude(Base=boundary_surfaces, Direction=unit_z)  # disabled
box = Box(extrude)  # disabled
surface_morph = SurfaceMorph(
    Geometry=extrude,
    Reference=box,
    Surface=reparameterize(surface_2),
    UDomain=number_slider_4,
    VDomain=construct_domain,
    WDomain=number_slider_5)  # disabled

# ----
# Life
# Module
toggle_2 = BooleanToggle(True)
geo_13 = Geometry(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)
attribute_7 = Wasp_Attribute(ID="Vertical", VAL=geo_13, TR=toggle_2)  # -> ATTR; inputs VAL: list, TR: Boolean; plug-in component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

geo_14 = Geometry(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)
attribute_8 = Wasp_Attribute(ID="Bridge", VAL=geo_14, TR=Toggle(True))  # -> ATTR; inputs VAL: list, TR: Boolean; plug-in component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

# ----
# Docking
# Module
toggle_3 = BooleanToggle(True)
geo_15 = Geometry(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)
# Support
# Module
# 9
attribute_9 = Wasp_Attribute(ID="Support1", VAL=geo_15, TR=toggle_3)  # -> ATTR; inputs VAL: list, TR: Boolean; plug-in component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

geo_16 = Geometry(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)
crv_7 = Curve([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])
panel_6 = Panel("""HOR_A
HOR_B""")
pt_7 = Point([Point(15.5, 5.196152423, 2), Point(24.49999988, 5.196152423, 2)])
conndir_7 = Wasp_ConnectionFromDirection(GEO=geo_16, CEN=pt_7, UP=crv_7, T=panel_6)  # -> CONN, PLN_OUT; inputs CEN: list of Point3d, UP: list of Curve, T: list; plug-in component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
part_7 = Wasp_BasicPart(NAME="HOR_MOD", GEO=geo_16, CONN=flatten(conndir_7.CONN), ATTR=attribute_8)  # -> PART; inputs GEO: Mesh, CONN: list, ATTR: list; plug-in component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

geo_17 = Geometry(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)
pt_8 = Point(Point(0.05659140862, -45.19615242, 9))
crv_8 = Curve(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)
conndir_8 = Wasp_ConnectionFromDirection(GEO=geo_17, CEN=pt_8, UP=crv_8, T="SUP_A")  # -> CONN, PLN_OUT; inputs CEN: list of Point3d, UP: list of Curve, T: list; plug-in component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
# Vertical
# Module
# 8
part_8 = Wasp_BasicPart(NAME="SUP_MOD1", GEO=geo_17, CONN=flatten(conndir_8.CONN), ATTR=attribute_9)  # -> PART; inputs GEO: Mesh, CONN: list, ATTR: list; plug-in component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

panel_7 = Panel("""VER_BOT
VER_BOT
VER_BOT
VER_MID
VER_MID
VER_MID
VER_TOP
VER_TOP
VER_TOP
VER_POW
VER_SUP""")

geo_18 = Geometry(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)
pt_9 = Point([<point referenced from the Rhino model> x11])
crv_9 = Curve([<curve referenced from the Rhino model> x11])
conndir_9 = Wasp_ConnectionFromDirection(GEO=geo_18, CEN=pt_9, UP=crv_9, T=panel_7)  # -> CONN, PLN_OUT; inputs CEN: list of Point3d, UP: list of Curve, T: list; plug-in component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
# 7
# Horizontal
# Module
advpart = Wasp_AdvancedPart(NAME="VER_MOD", GEO=geo_18, CONN=flatten(conndir_9.CONN), ATTR=attribute_7)  # -> PART; inputs GEO: Mesh, CONN: list, HI: list, ATTR: list, SUP: list, AEC: list, OC: list; plug-in component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

curve_3 = Curve(<curve referenced from the Rhino model>)

geo_19 = Geometry(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)
attribute_10 = Wasp_Attribute(ID="Support2", VAL=geo_19, TR=Toggle(True))  # -> ATTR; inputs VAL: list, TR: Boolean; plug-in component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

geo_20 = Geometry(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)
pt_10 = Point(Point(-18.56247304, -45.19615242, 9))
crv_10 = Curve(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)
conndir_10 = Wasp_ConnectionFromDirection(GEO=geo_20, CEN=pt_10, UP=crv_10, T="SUP_B")  # -> CONN, PLN_OUT; inputs CEN: list of Point3d, UP: list of Curve, T: list; plug-in component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
part_9 = Wasp_BasicPart(NAME="SUP_MOD2", GEO=geo_20, CONN=flatten(conndir_10.CONN), ATTR=attribute_10)  # -> PART; inputs GEO: Mesh, CONN: list, ATTR: list; plug-in component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

geo_21 = Geometry(<brep referenced from the Rhino model>)
geo_22 = Geometry(<brep referenced from the Rhino model>)
# Power
# Module
# 11
attribute_11 = Wasp_Attribute(ID="Power", VAL=[geo_21, geo_22], TR=Toggle(True))  # -> ATTR; inputs VAL: list, TR: Boolean; plug-in component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

pt_11 = Point(<point referenced from the Rhino model>)
geo_23 = Geometry(<brep referenced from the Rhino model>)
crv_11 = Curve(<curve referenced from the Rhino model>)
conndir_11 = Wasp_ConnectionFromDirection(GEO=geo_23, CEN=pt_11, UP=crv_11, T="POW_A")  # -> CONN, PLN_OUT; inputs CEN: list of Point3d, UP: list of Curve, T: list; plug-in component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
# Support
# Module
# 10
part_10 = Wasp_BasicPart(NAME="POW_MOD", GEO=geo_23, CONN=flatten(conndir_11.CONN), ATTR=attribute_11)  # -> PART; inputs GEO: Mesh, CONN: list, ATTR: list; plug-in component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

adjexcconst = Wasp_AdjacencyExclusionConstraint(DIR=curve_3, PN="SUP_MOD1", AE=Toggle(True))  # -> AEC; inputs DIR: list of Curve, PN: list, AE: Boolean; plug-in component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

panel_8 = Panel("""CEN_TOP>POD_A
CEN_TOP>HOR_A
CEN_TOP>HOR_B
CEN_TOP>LIF_A
CEN_MID>POD_A
CEN_MID>HOR_A
CEN_MID>HOR_B
CEN_BOT>POD_A
CEN_BOT>HOR_A
CEN_BOT>HOR_B
CEN_BOT>FCT_A
FOD_A>POD_A
FOD_A>HOR_A
FOD_A>LIF_A
FOD_A>LIF_B
FOD_A>FCT_A
FOD_A>FCT_B
FOD_B>DOC_A
FOD_B>POD_A
FOD_B>HOR_B
FOD_B>FCT_B
FOD_B>LIF_A
FOD_B>LIF_B
DOC_A>FOD_B
DOC_A>POD_A
DOC_A>HOR_B
DOC_A>VER_MID
DOC_A>FCT_B
DOC_A>FCT_A
DOC_A>LIF_B
POD_A>POD_A
POD_A>FOD_A
POD_A>FOD_B
POD_A>DOC_A
POD_A>HOR_A
POD_A>HOR_B
POD_A>FCT_A
POD_A>FCT_B
POD_A>VER_TOP
POD_A>VER_BOT
HOR_A>FOD_A
HOR_A>POD_A
HOR_A>HOR_B
HOR_A>VER_TOP
HOR_A>VER_MID
HOR_A>VER_BOT
HOR_A>LIF_A
HOR_A>LIF_B
HOR_A>FCT_A
HOR_A>FCT_B
HOR_A>CEN_TOP
HOR_A>CEN_MID
HOR_A>CEN_BOT
HOR_B>FOD_B
HOR_B>POD_A
HOR_B>VER_TOP
HOR_B>VER_MID
HOR_B>VER_BOT
HOR_B>LIF_A
HOR_B>LIF_B
HOR_B>FCT_A
HOR_B>FCT_B
HOR_B>CEN_TOP
HOR_B>CEN_MID
HOR_B>CEN_BOT
VER_TOP>POD_A
VER_TOP>HOR_A
VER_TOP>HOR_B
VER_MID>POD_A
VER_MID>HOR_A
VER_MID>HOR_B
VER_BOT>POD_A
VER_BOT>HOR_A
VER_BOT>HOR_B
VER_BOT>FOD_A
VER_BOT>FCT_A
VER_BOT>LIF_B
FCT_A>POD_A
FCT_A>HOR_A
FCT_A>HOR_B
FCT_B>POD_A
FCT_B>HOR_A
FCT_B>HOR_B
FCT_B>FOD_B
LIF_A>FOD_B
LIF_A>DOC_A
LIF_A>POD_A
LIF_A>HOR_A
LIF_A>HOR_B
LIF_A>LIF_B
LIF_A>CEN_TOP
LIF_B>FOD_B
LIF_B>DOC_A
LIF_B>POD_A
LIF_B>HOR_A
LIF_B>HOR_B
LIF_B>LIF_A
VER_SUP>SUP_A
SUP_A>VER_SUP
FOD_SUP>SUP_B
SUP_B>FOD_SUP
VER_POW>POW_A
POW_A>VER_POW""")

# ----
# Create Display Window
boolean_toggle = BooleanToggle(False)
launch_window = LaunchWindow(
    Show=boolean_toggle,
    Name="BSA_Martian Village",
    Width=Slider(800, range=0..1000),
    Height=Slider(640, range=0..1000),
    FontFamily="Bebas Neue",
    ChildStatus=0,
    EnableHorizScroll=False)  # disabled

field = Wasp_Field(NAME="Mars_Terrain", E_FIELD=fieldpts_2.E_FIELD, VAL=weave)  # -> FIELD; inputs VAL: list; plug-in component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

# ----
# Stochastic Aggregation
merge = Merge(
    Data1=part_3,
    Data2=part,
    Data3=part_2,
    Data4=part_4,
    Data5=part_5,
    Data6=part_6,
    Data7=part_7,
    Data8=advpart,
    Data9=part_8,
    Data10=part_9,
    Data11=part_10)
number_slider_8 = Slider(500, range=0..1000)
rulegen = Wasp_RulesGenerator(PART=merge, SELF_P=Toggle(True), GR=panel_8)  # -> R; inputs PART: list, SELF_P: Boolean, SELF_C: Boolean, TYP: Boolean, GR: list; plug-in component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

# ----
# Number of Pieces
boolean_toggle_2 = BooleanToggle(True)
panel_9 = Panel("""2
45
8
8
40
18
80
15
15
20
20""")
partcat = Wasp_PartsCatalog(PART=flatten(merge), NUM=panel_9, LIM=boolean_toggle_2, AD=Toggle(False))  # -> CAT; inputs PART: list, NUM: list, LIM: Boolean, AD: Boolean; plug-in component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

fieldaggregation = Wasp_FieldDrivenAggregation(
    PART=flatten(merge),
    PREV=part_3,
    N=Slider(200, range=0..1000),
    RULES=rulegen,
    FIELD=field,
    CAT=partcat,
    MODE=Slider(1, range=0..1),
    RESET=Button())  # -> AGGR, PART_OUT; inputs PART: list, PREV: list, N: Int32, RULES: list, FIELD: list, MODE: Int32, GC: list, RESET: Boolean; plug-in component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

stochasticaggregation = Wasp_StochasticAggregation(
    PART=flatten(merge),
    PREV=part_3,
    N=number_slider_8,
    RULES=rulegen,
    CAT=partcat,
    MODE=Slider(1, range=0..3),
    RESET=Button())  # -> AGGR, PART_OUT; inputs PART: list, PREV: list, N: Int32, RULES: list, SEED: Int32, MODE: Int32, GC: list, RESET: Boolean; plug-in component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

# ----
# Visualizer
panel_10 = Panel("Factory")
getattr = Wasp_GetAttributeByName(PART=stochasticaggregation.PART_OUT, ID=panel_10)  # -> VAL; plug-in component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
getattr_2 = Wasp_GetAttributeByName(PART=stochasticaggregation.PART_OUT, ID="Support1")  # -> VAL; plug-in component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
getattr_3 = Wasp_GetAttributeByName(PART=stochasticaggregation.PART_OUT, ID="Power")  # -> VAL; plug-in component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
getattr_4 = Wasp_GetAttributeByName(PART=stochasticaggregation.PART_OUT, ID="Support2")  # -> VAL; plug-in component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
getattr_5 = Wasp_GetAttributeByName(PART=stochasticaggregation.PART_OUT, ID="Pod")  # -> VAL; plug-in component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
getattr_6 = Wasp_GetAttributeByName(PART=stochasticaggregation.PART_OUT, ID="Bridge")  # -> VAL; plug-in component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
getattr_7 = Wasp_GetAttributeByName(PART=stochasticaggregation.PART_OUT, ID="Vertical")  # -> VAL; plug-in component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
getattr_8 = Wasp_GetAttributeByName(PART=stochasticaggregation.PART_OUT, ID="Life")  # -> VAL; plug-in component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
getattr_9 = Wasp_GetAttributeByName(PART=stochasticaggregation.PART_OUT, ID="Central")  # -> VAL; plug-in component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
getattr_10 = Wasp_GetAttributeByName(PART=stochasticaggregation.PART_OUT, ID="Food")  # -> VAL; plug-in component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
getattr_11 = Wasp_GetAttributeByName(PART=stochasticaggregation.PART_OUT, ID="Docking")  # -> VAL; plug-in component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

preview = CustomPreview(Geometry=getattr, Material=ColourSwatch(SwatchColor=RGB(91, 113, 178)))
preview_2 = CustomPreview(Geometry=getattr_2, Material=ColourSwatch(SwatchColor=RGB(178, 91, 165)))
preview_3 = CustomPreview(Geometry=getattr_6, Material=ColourSwatch(SwatchColor=RGB(148, 148, 148)))
preview_4 = CustomPreview(Geometry=getattr_7, Material=ColourSwatch(SwatchColor=RGB(102, 102, 102)))
preview_5 = CustomPreview(Geometry=getattr_8, Material=ColourSwatch(SwatchColor=RGB(153, 125, 125)))
preview_6 = CustomPreview(Geometry=getattr_9, Material=ColourSwatch(SwatchColor=RGB(147, 153, 125)))
preview_7 = CustomPreview(Geometry=getattr_10, Material=ColourSwatch(SwatchColor=RGB(153, 142, 125)))
preview_8 = CustomPreview(Geometry=getattr_11, Material=ColourSwatch(SwatchColor=RGB(91, 178, 132)))
preview_9 = CustomPreview(Geometry=getattr_3, Material=ColourSwatch(SwatchColor=RGB(217, 56, 99)))
preview_10 = CustomPreview(Geometry=getattr_4, Material=ColourSwatch(SwatchColor=RGB(178, 91, 165)))

# ---- group: Custom Preview
preview_11 = CustomPreview(Geometry=getattr_5, Material=ColourSwatch(SwatchColor=RGB(199, 199, 199)))

# ----
# UI ELEMENTS
partgeo = Wasp_GetPartGeometry(PART=stochasticaggregation.PART_OUT)  # -> GEO; disabled; plug-in component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
create_button = CreateButton(ButtonName="Reset", ButtonStyle=0)
create_color_picker = CreateColorPicker(DefaultColor=ColourSwatch(SwatchColor=RGB(255, 255, 255)))
create_3d_view = Create3DView(
    MeshToDisplay=flatten(partgeo),
    MeshColors=ColourSwatch(SwatchColor=RGB(255, 255, 255)),
    ViewWidth=Slider(303, range=0..1000),
    ViewHeight=Slider(315, range=0..1000))
create_slider = CreateSlider(
    Slider=number_slider_8,
    SnapValue=Slider(10, range=0..10),
    ShowBounds=False,
    ShowTicks=False,
    ShowTooltip=False,
    ShowValLabel=True,
    showLabel=True)  # disabled

# ----
# Save Aggregation
panel_11 = Panel("G:\00_COMPETITION_Martian Village\SAVED AGGREGATIONS")
path = FilePath(panel_11)
saveaggr = Wasp_SaveAggregationToFile(AGGR=stochasticaggregation.AGGR, PATH=path, NAME="Final_1", SAVE=Button())  # -> TXT, FILE; inputs SAVE: Boolean; plug-in component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

# ----
# Continue to Form
# Load Aggregation
data = Data(part_4)
path_2 = FilePath("G:\00_COMPETITION_Martian Village\SAVED AGGREGATIONS\Final_1.json")
panel_12 = Panel(path_2)
loadaggr = Wasp_LoadAggregationFromFile(FILE=path_2)  # -> PART_OUT; inputs PART: list; plug-in component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
data_2 = Data(rulegen)
stochasticaggregation_2 = Wasp_StochasticAggregation(PREV=loadaggr, N=Slider(200, range=0..1000), RULES=data_2, RESET=Button())  # -> AGGR, PART_OUT; inputs PART: list, PREV: list, N: Int32, RULES: list, SEED: Int32, MODE: Int32, GC: list, RESET: Boolean; plug-in component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
partgeo_2 = Wasp_GetPartGeometry(PART=loadaggr)  # -> GEO; plug-in component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
lng = ListLength(List=loadaggr)
split = SplitList(List=stochasticaggregation_2.PART_OUT, Index=lng)  # -> ListA, ListB
partgeo_3 = Wasp_GetPartGeometry(PART=split.ListA)  # -> GEO; plug-in component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
partgeo_4 = Wasp_GetPartGeometry(PART=split.ListB)  # -> GEO; plug-in component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

merge_2 = Merge(Data1=create_3d_view, Data2=create_slider, Data3=create_button, Data4=create_color_picker)
add_elements = AddElements(Window=launch_window, Elements=flatten(merge_2), DoVLChecking=True)  # -> AddedElements, ElementNames
value_listener = ValueListener(Elements=create_slider, SomeProperty=True)  # -> Values, Indices
value_listener_2 = ValueListener(Elements=create_button, SomeProperty=True)  # -> Values, Indices
value_listener_3 = ValueListener(Elements=create_color_picker, SomeProperty=True)  # -> Values, Indices

# ==== cluster Remap: Remaps numbers
data = ClusterInput()
min = ClusterInput()
max = ClusterInput()
bnd = Bounds(Numbers=data)
dom = ConstructDomain(DomainStart=min, DomainEnd=max)
remap = RemapNumbers(Value=data, Source=bnd, Target=dom)  # -> Mapped, Clipped
R = ClusterOutput(remap.Mapped)
